% Requirement links of CruiseTest.m (R2023a)

% lines 1-8 verifies MathworksRequirements.slreqx#5
classdef CruiseTest < matlab.unittest.TestCase
    methods (Test)
        function cruiseFunc(testCase)
            cruiseMach = cruiseFunc;
            testCase.verifyGreaterThan(cruiseMach, 1.2)
        end
    end
end