% Requirement links of cabinLayoutFunc.m (R2023a)

% lines 1-6 relates to MathworksRequirements.slreqx#13
function [cabinHeight, carryOnVol] = cabinLayoutFunc()
    %Enter the height of the cabin in feet
    cabinHeight = 6;
    %Enter the approximate space available for a carry on per seat in ft^3
    carryOnVol = 3;
end