% Requirement links of takeoffPerformanceFunc.m (R2023a)

% lines 1-6 relates to MathworksRequirements.slreqx#2
function maxMinTakeoffDistance = takeoffPerformanceFunc()
    %Enter the maximum, minimum takeoff distance in feet
    %i.e. can the plane takeoff within 8000 feet
    %so is the result less than 8000
    maxMinTakeoffDistance = 6500;
end