# Requirement set MathworksRequirements (R2023a)

## 1 [1] Operable at major international airports
The aircraft should be able to land, takeoff, and operate in major airports.
Rationale: From the RFP document. Being able to operate, land, and takeoff at major international airports allows for more flexibility in flying routes.

### 1.1 [3] Airport Gate Compatibility
The aircraft should have gate compatibility with airports. Either FAA Aircraft Design Group 5 or ICAO Code E. (Requires wingspan to be less than 214 ft and tail height less than 66 ft)
Rationale: From the RFP.

### 1.2 [4] Taxiway Compatibility
The aircraft should have airport taxiway compatibility. Twaxiway Design Group 6. (Requires outer-to-outer Main Gear Width (MGW) of 35-45 ft, and Cockpit (nose gear) to Main Gear distance of 100-125 ft).
Rationale: From the RFP.

### 1.3 [2] Takeoff
The aircraft should takeoff and land on runways of at least 8,000 feet.
Rationale: From the RFP. The lower estimate for the average length of a runway is around 8,000 feet. The aircraft needs to accomodate for this takeoff and landing parameter to maintain diverse flight routes to satisfiy the customer.

## 2 [5] Cruise Speed
The aircraft should have a minimum cuise speed of Mach 1.2. (Goal of Mach 1.8)
Rationale: From the RFP.

## 3 [6] Payload
The aircraft should have a minimum payload capacity of 6 passengers. (Goal of 40 passengers).
Rationale: From the RFP.

## 4 [7] Range
The aircraft should have a range of at least 2,000 nautical miles. (Goal of 5000 nautical miles).
Rationale: From the RFP.

## 5 [8] Noise Compliance
The aircraft must adhere to the ICAO Chapter 14 limits. The sonic shock overland must be less than 75 EPNL (Effective Perceived Noise Level).
Rationale: From the RFP.

## 6 [9] Certification and Entry Into Service
The aircraft must meet 14 CFR Part 25 (or equivalent international) certification standards. All components, including engines, must be certifiable by 2034. Target EIS: 2035.
Rationale: From the RFP.

## 7 [10] Weather Operations
The aircraft should be capable in safe operations in all conditions, with emphasis on icy conditions.
Rationale: From the RFP.

## 8 [11] Compatible with SAFs
The aircraft should be compatibile with sustainable aviation fuels (SAF).
Rationale: From the RFP.

## 9 [12] Cabin Comfort Features
The cabin should be comfortable for passengers.
Rationale: From the RFP.

### 9.1 [13] Stand-up Cabin
The cabin should have enough space for an average sized passenger to stand up.
Rationale: From the RFP.

### 9.2 [14] Space for Carry Ons
The cabin should have compartments or space dedicated to luggage that passengers can carry onto the aircraft.
Rationale: From the RFP.

## 10 [15] Class Seating
The aircraft should be capable of having a seating layout for at least two classes.
Rationale: From the RFP.

## 11 [#50] Old requirements (subteams)

### 11.1 [16] Propulsion Requirements
Rationale: From comparator aircraft and market research.

#### 11.1.1 [17] Fuel Type
The aircraft should be compatiable with commonly used jet fuels. Common international and domestic jet fuels used include Jet A and Jet A-1.

#### 11.1.2 [18] Thrust Requirement
The aircraft should produce enough thrust to reach a minimum cruise speed of Mach 1.2. (Goal of Mach 1.8)

#### 11.1.3 [19] Specific Fuel Consumption
The aircraft should have a specific fuel consumption of less than or equal to 1.15 lb/lbf*hr (or 118 kg/kN*hr) at cruising speed.

#### 11.1.4 [20] ICAO Emissions
The aircraft should fulfuill ICAO regulations on nitric oxide, nitrogen dioxide, and carbon dioxide emissions.

### 11.2 [20] Aerodynamic Requirements
Rationale: From comparator aircraft and market research.

#### 11.2.1 [22] Critical Mach Number
The aircraft should have wings that result in a critical Mach number as high as possible.

#### 11.2.2 [23] Glide Ratio
The wings should provide a high glide ratio in subsonic and supersonic flight.

#### 11.2.3 [24] Lift
The lift gradient should be as high as possible so that higher approach speeds do not require large anlges of attack.

#### 11.2.4 [21] Wave Drag
The wings should produce a wave drag as low as possible.

### 11.3 [25] Weights and Balances Requirements
Rationale: From comparator aircraft and market research.

#### 11.3.1 [26] Center of Gravity
The center of gravity should maintain a constant position for the entirety of the flight.

#### 11.3.2 [27] Weight Distribution
The aircraft must be able to maintain proper weight distibution at any

#### 11.3.3 [28] Turbulent Winds
The wings and tail should be able to withstand turbulent winds withouth deformation.

#### 11.3.4 [29] Enviormental Factor
The materials used should be able to withstand any enviormental factors the plane should encounter

### 11.4 [30] Stability and Control
Rationale: From comparator aircraft and market research.

#### 11.4.1 [31] Static Margin
The aircraft shall maintain a positive static margin through all flight segments.

#### 11.4.2 [32] Climb Recovery
The aircraft should recover from a high angle of attack climb.

#### 11.4.3 [33] Control Surfaces
The aircraft's control surfaces should maintain enough effectiveness while maintaining cruising speed.

#### 11.4.4 [34] Deflection Limit
The aircraft's control surfaces should have a maximum deflection limit to prevent loading issues.

### 11.5 [35] Systems Requirements
Rationale: From comparator aircraft and market research.

#### 11.5.1 [36] Communication System
The aircraft should have sufficient communications systems to maintain contact with air traffic control when crossing oceans and areas where signal jamming is used.

#### 11.5.2 [37] Envelope Stability
The aircraft should have a flight control system that satisfies the longitudinal and lateral-directional stability requirements through the flight envelope.

#### 11.5.3 [38] Handling Quality
The aircraft should have a Cooper-Harper handling rating at most a 2.

### 11.6 [39] Perfomance Requirements

#### 11.6.1 [40] Climb Rate
The aircraft should have a climb rate of at least 3,500 feet per minute.

#### 11.6.2 [41] Acceleration
The aircraft should accelerate to a supersonic speed from takeoff in under 40 minutes.

#### 11.6.3 [42] Cruise Altitude
The aircraft should have a cruise altitude of at least 40,000 feet.

#### 11.6.4 [43] One Engine Inoperative
The aircraft should be controllable, takeoff, climb, cruise, and land while having one engine inoperative.