# Requirement set StarScreamRequirements (R2023a)

## 1 [#1] Airport Gate Compatibility
The aircraft should have gate compatibility with airports. Either FAA Aircraft Design Group 5 or ICAO Code E. (Requires wingspan to be less than 214 ft and tail height less than 66 ft)

## 2 [#2] Taxiway Compatibility
The aircraft should have airport taxiway compatibility. Twaxiway Design Group 6. (Requires outer-to-outer Main Gear Width (MGW) of 35-45 ft, and Cockpit (nose gear) to Main Gear distance of 100-125 ft).

## 3 [#3] Takeoff
The aircraft should takeoff and land on runways of at least 8,000 feet.

## 4 [#4] Cruise Speed
The aircraft should have a minimum cuise speed of Mach 1.2. (Goal of Mach 1.8)

## 5 [#5] Passenger Count
The aircraft should have a minimum payload capacity of 6 passengers. (Goal of 40 passengers).

## 6 [#6] Range
The aircraft should have a range of at least 2,000 nautical miles. (Goal of 5000 nautical miles).

## 7 [#7] Noise Level
The aircraft must adhere to the ICAO Chapter 14 limits. The sonic shock overland must be less than 75 EPNL (Effective Perceived Noise Level).

## 8 [#8] Certification and Entry into Service
The aircraft must meet 14 CFR Part 25 (or equivalent international) certification standards. All components, including engines, must be certifiable by 2034. Target EIS: 2035.

## 9 [#9] Weather Operations
The aircraft should be capable in safe operations in all conditions, with emphasis on icy conditions.

## 10 [#10] Compatible with SAFs
The aircraft should be compatibile with sustainable aviation fuels (SAF).

## 11 [#11] Cabin Space
The cabin should have enough space for an average sized passenger to stand up.

## 12 [#12] Baggage Space
The cabin should have compartments or space dedicated to luggage that passengers can carry onto the aircraft.

## 13 [#13] Seating Space and Amenities
The aircraft should be capable of having a seating layout for at least two classes.

## 14 [14] Wing Requirements

### 14.1 [#25] Lift at Cruise
The wing shall generate enough lift to sustain steady level cruise at an alititude of 60,000 feet at Mach 1.8 and at maximum cruise weight.

### 14.2 [#32] Transonic
The wing shall limit the drag increase during the transonic regime during acceleration from Mach 0.9 to Mach 1.2 so that the desired cruise speed can be achieved by the engine's thrust limits.

### 14.3 [#33] Lift at Takeoff
The wing shall provide provide enough lift to meet takeoff and landing field length requirements at maximum takeoff and landing weights.

### 14.4 [#57] Roll Stability
The wing shall provide sufficient stabilizing moment to ensure positive lateral static stability throughout the approved flight envelope.

### 14.5 [#60] Control Surface Reversal Prevention - Wing
The wing structure shall maintain sufficient stiffness to prevent control surface reversal within the approved flight envelope.

### 14.6 [#34] Wing load structure
The wing's structures shall withstand limit loads without deformation and ultimate loads without failure.
Rationale: FAA title 14 part 25 subpart c

### 14.7 [#35] Wing heating structure
The wing shall withstand heating loads and expansion corresponding to sustained Mach 1.8 cruise.

### 14.8 [#42] Wing weight structure
The wing's strucutre shall withstand stress due to engine weight, fuel weight, and weight associated with control surface mechanisms through the entire flight envelope with a factor of safety.

### 14.9 [#39] Wing Volume
The wings shall have an internal volume capable of housing fuel tanks, landing gear, and control surface mechanisms for the designed mission.

### 14.10 [#44] Enviorment Protection
The wing shall have the structural protection to withstand impact from bird strike, lightning strikes, and weather conditions during flight.

## 15 [#17] Fuselage Requirements

### 15.1 [#29] Fuselage structure
The fuselage structure shall withstand limit loads without permanent deformation and ultimate loads without structural failure.

### 15.2 [#45] Fuselage heating and expansion
The fuselage structure shall withstand heating loads and expansion associated with sustained cruise Mach without inducing structural failure or loss of pressurization.

### 15.3 [#46] Fuselage cabin volume
The fuselage shall have sufficient volume to house a minimum of passengers 40 and associated baggage in the cabin.

### 15.4 [#47] Internal volume
The fuselage shall have sufficient volume to house the necessary wiring, mechanical components, and baggage in the fuselage.

### 15.5 [#48] Cabin pressure
The fuselage structure shall withstand loads associated with the pressurization of the cabin at the greatest pressure difference of the flight.

### 15.6 [#49] Aerodynamic performance
The fuselage shall minimize drag to allow for a cruise of Mach 1.8

### 15.7 [#50] Emergency Exits
The fuselage shall include sufficient emergency exits to allow evacuation of all passengers and crew under certification conditions.

### 15.8 [#51] Enviornment protection
The fuselage shall have structural protection from enviormental effects including bird strikes, lighting strikes, and weather conditions during flight.

### 15.9 [#52] Transmitted loads
The fuselage structure shall support loads transmitted from the wing and empennage without exceeding allowable structural limits.

## 16 [#18] Empennage Requirements

### 16.1 [#30] Pitch Stability
The empennage shall provide sufficient stabilizing moment to ensure positive longitudinal static stability throughout the approved flight envelope.

### 16.2 [#53] Yaw Stability
The empennage shall provide sufficient directional stability such that the aircraft maintains positive weathercock stability throughout the approved flight envelope.

### 16.3 [#56] Control Surface Reversal Prevention - Empennage
The empennage structure shall maintain sufficient stiffness to prevent control surface reversal within the approved flight envelope.

### 16.4 [#54] Empennage structure
The empennage structure shall withstand limit loads without permanent deformation and ultimate loads without structural failure.

### 16.5 [#55] Empennage heating
The empennage structure shall withstand heating loads and expanison associated with sustained supersonic cruise withou exceeding allowable material temperature limits.

### 16.6 [#61] Aerodynamic performance
The empennage shall maintain stable aerodynamic performance when operating within the wake of upstream aircraft components.

### 16.7 [#62] Gust loads
The empennage shall withstand gust loads encountered within the operational flight envelope without structural failure.

## 17 [#20] Flight Control System

### 17.1 [#73] Autopilot Capability
The flight control system shall support autopilot functionality capable of maintaining commanded flight path parameters.

### 17.2 [#70] Handling qualities
The flight control system shall provide aircraft handling qualities consistent with applicable civil transport aircraft standards.

### 17.3 [#71] Control During Flight regimes
The flight control system shall maintain aircraft stability and controllability during transitions between subsonic, transonic, and supersonic flight regimes.

### 17.4 [#68] Control Respnsiveness
The control surfaces shall respond to commanded inputs within a response time consistent with aircraft stability and handling quality requirements.

### 17.5 [#72] CG Shift Trim
The flight control system shall maintain trim capability across the full approved center-of-gravity range.

### 17.6 [#43] Pitch Control Authority
The control surfaces shall provide sufficient pitch control authority at minimum approach speed and at cruise Mach number.

### 17.7 [#41] Roll Control Authority
The control surfaces shall provide sufficient roll control authority at minimum approach speed and at cruise Mach number.

### 17.8 [#26] Yaw Control Authority
The control surfaces shall provide sufficient yaw control authority at minimum approach speed and at cruise Mach number.

### 17.9 [#64] Aerodynamic Performance
The control surfaces shall allow the aircraft to maintain trimmed cruise flight without excessive control deflection that would significantly increase aerodynamic drag.

### 17.10 [#58] Control Effectiveness
The control surfaces shall maintain adequate control effectiveness throughout the approved flight envelope.

### 17.11 [#59] O.E.I. Yaw Control
The rudder shall provide sufficient control authority to maintain directional stability following the failure of the most critical engine during takeoff and climb.

### 17.12 [#66] Actuators/hinge structures
The control surface actuators and hinge structures shall withstand maximum hinge moments encountered throughout the flight envelope.

### 17.13 [#67] Deflection limits
The control surfaces shall operate within defined deflection limits sufficient to maintain aircraft controllability throughout the flight envelope.

### 17.14 [#69] Actuator Failure Redundancy
The control surface system shall maintain aircraft controllability following failure of any single actuator or control channel.

### 17.15 [#89] Engine Control
The propulsion system shall include a control system capable of regulating engine thrust throughout the flight envelope.

## 18 [#21] Landing Gear System

### 18.1 [#27] Load Capability
The landing gear shall withstand landing loads associated with the maximum landing weight without structural failure.

### 18.2 [#74] General Operations
The landing gear shall support the aircraft during ground operations, takeoff, and landing without exceeding allowable structural limits.

### 18.3 [#75] Retraction and Extension
The landing gear shall retract fully into the aircraft structure and extend reliably throughout the operational flight envelope.

### 18.4 [#76] Breaks
The landing gear braking system shall provide sufficient braking force to achieve the required landing stopping distance.

### 18.5 [#77] Impact Absorbtion
The landing gear shall absorb landing impact energy without transmitting excessive loads to the aircraft structure.

### 18.6 [#78] Emergency Extension
The landing gear shall include a mechanism for emergency deployment in the event of primary system failure.

## 19 [#22] Electrical and Avionics System

### 19.1 [#28] Power Supply
The electrical power system shall supply sufficient electrical power to all aircraft systems throughout all phases of flight.

### 19.2 [#80] Power System Redundancy
The electrical power system shall include redundant power sources such that the failure of a single power source does not result in loss of critical avionics systems.

### 19.3 [#81] Avionics Accuracy
The avionics system shall measure aircraft state parameters including altitude, airspeed, attitude, and position with accuracy sufficient to maintain safe aircraft navigation and control throughout the flight envelope.

### 19.4 [#82] Flight Navigation
The avionics system shall provide navigation capability sufficient for operation along the planned flight route.

### 19.5 [#83] Flight Communication
The avionics system shall provide reliable communication between the aircraft and air traffic control.

### 19.6 [#84] System Health Monitoring
The avionics system shall monitor the health and status of critical aircraft systems and detect and report failures in avionics components and sensors

## 20 [#31] Propulsion System Requirements

### 20.1 [17] Fuel Type
The propulsion system should be compatiable with commonly used jet fuels. Common international and domestic jet fuels used include Jet A and Jet A-1.

### 20.2 [18] Cruise Thrust
The propulsion system shall provide sufficient thrust to sustain steady cruise flight at Mach 1.8 and the design cruise altitude.

### 20.3 [#85] Takeoff Thrust
The propulsion system shall provide sufficient thrust to enable aircraft takeoff at maximum takeoff weight within the required takeoff field length.

### 20.4 [#38] Fuel Consumption
The propulsion system should have a fuel consumption to allow for the desired mission range.

### 20.5 [#86] Safety
The propulsion system shall operate in all flight conditions and operations without compressor instability, unstart or surge.

### 20.6 [#87] Engine Loads
The engine structure shall withstand aerodynamic, thermal, vibration, and inertial loads encountered during all phases of flight.

### 20.7 [#88] Noise Compliance
The propulsion system shall comply with applicable aircraft noise regulations during takeoff, climb, and landing operations.