% Requirement links of ADGTest.m (R2023a)

% lines 1-9 verifies MathworksRequirements.slreqx#3
% lines 1-9 verifies StarScreamRequirements.slreqx#1
classdef ADGTest < matlab.unittest.TestCase
    methods (Test)
        function range_func(testCase)
            [wingSpan, tailHeight] = gateCompatibiltyFunc();
            testCase.verifyLessThan(wingSpan, 214)
            testCase.verifyLessThan(tailHeight, 66)
        end
    end
end