% Requirement links of NoiseTest.m (R2023a)

% lines 1-8 verifies StarScreamRequirements.slreqx#7
% lines 1-8 verifies MathworksRequirements.slreqx#8
classdef NoiseTest < matlab.unittest.TestCase
    methods (Test)
        function noiseFuncTest(testCase)
            noise = noiseFunc();
            testCase.verifyLessThan(noise, 75)
        end
    end
end