% Requirement links of RangeTest.m (R2023a)

% lines 1-8 verifies MathworksRequirements.slreqx#7
classdef RangeTest < matlab.unittest.TestCase
    methods (Test)
        function rangeFunc(testCase)
            range = rangeFunc();
            testCase.verifyGreaterThan(range, 2000)
        end
    end
end