% Requirement links of TDGTest.m (R2023a)

% lines 1-9 verifies MathworksRequirements.slreqx#4
% lines 1-9 verifies StarScreamRequirements.slreqx#2
classdef TDGTest < matlab.unittest.TestCase
    methods (Test)
        function taxiwayCompatibilityFunc(testCase)
            [MGW, CtMG] = gateCompatibiltyFunc();
            testCase.verifyLessThan(MGW, 42)
            testCase.verifyLessThan(CtMG, 140)
        end
    end
end