% Requirement links of takeoffDistanceTest.m (R2023a)

% lines 1-8 verifies MathworksRequirements.slreqx#2
% lines 1-8 verifies StarScreamRequirements.slreqx#3
classdef takeoffDistanceTest < matlab.unittest.TestCase
    methods (Test)
        function takeoffPerformanceTest(testCase)
            takeoff = takeoffPerformanceFunc();
            testCase.verifyLessThan(takeoff, 8000)
        end
    end
end