% Requirement links of AirportTest.m (R2023a)

% lines 1-8 verifies MathworksRequirements.slreqx#1
classdef AirportTest < matlab.unittest.TestCase
    methods (Test)
        function airportCompatibiltyFunc(testCase)
            airports = airportCompatibiltyFunc();
            testCase.verifyLessThan(airports, 40)
        end
    end
end