% Requirement links of PayloadTest.m (R2023a)

% lines 1-8 verifies MathworksRequirements.slreqx#6
classdef PayloadTest < matlab.unittest.TestCase
    methods (Test)
        function payloadFunc(testCase)
            passengerCount = payloadFunc();
            testCase.verifyGreaterThan(passengerCount, 6)
        end
    end
end