% Requirement links of taxiwayCompatibilityFunc.m (R2023a)

% lines 1-7 relates to MathworksRequirements.slreqx#4
function [MGW, CtMG] = taxiwayCompatibilityFunc()
    %Enter the distance of distance from the outside of one main gear tire
    %to the outside of the opposite main gear tire in feet
    MGW = 25;
    %Enter the distance from the cockpit to the main gear below in feet
    CtMG = 80;
end